% Simulink data dictionary crs_controller.sldd

enbl = Simulink.Signal(StorageClass="ImportedExtern", DataType="boolean")
cncl = Simulink.Signal(StorageClass="ImportedExtern", DataType="boolean")
speed_set = Simulink.Signal(StorageClass="ImportedExtern", DataType="boolean")
resume = Simulink.Signal(StorageClass="ImportedExtern", DataType="boolean")
inc = Simulink.Signal(StorageClass="ImportedExtern", DataType="boolean")
dec = Simulink.Signal(StorageClass="ImportedExtern", DataType="boolean")
brakeP = Simulink.Signal(StorageClass="ImportedExtern", DataType="single")
vehicle_speed = Simulink.Signal(StorageClass="ImportedExtern", DataType="single")
driver_throttle = Simulink.Signal(StorageClass="ImportedExtern", DataType="single")
key = Simulink.Signal(StorageClass="ImportedExtern", DataType="uint8")
gear = Simulink.Signal(StorageClass="ImportedExtern", DataType="uint8")
reqDrv = Simulink.Signal(StorageClass="ExportedGlobal", DataType="Enum: reqMode")
status = Simulink.Signal(StorageClass="ExportedGlobal", DataType="boolean")
op_mode = Simulink.Signal(StorageClass="ExportedGlobal", DataType="Enum: opMode")
cc_target_speed = Simulink.Signal(StorageClass="ExportedGlobal", DataType="single")
cc_throttle = Simulink.Signal(StorageClass="ExportedGlobal", DataType="single")
Drv_Override_Hi = Simulink.Parameter(15, StorageClass="ExportedGlobal", DataType="single")
Drv_Override_Lo = Simulink.Parameter(5, StorageClass="ExportedGlobal", DataType="single")
Kp = Simulink.Parameter(20, StorageClass="ExportedGlobal", DataType="single")
Ki = Simulink.Parameter(0.2, StorageClass="ExportedGlobal", DataType="single")
Kd = Simulink.Parameter(-0.0249, StorageClass="ExportedGlobal", DataType="single")
throttle_min = Simulink.Parameter(0, StorageClass="ExportedGlobal", DataType="single")
throttle_max = Simulink.Parameter(100, StorageClass="ExportedGlobal", DataType="single")
brake_threshold = Simulink.Parameter(5, StorageClass="ExportedGlobal", DataType="single")
press_hold_threshold_samples = Simulink.Parameter(50, StorageClass="ExportedGlobal", DataType="int32")
Spd_Min = Simulink.Parameter(40, StorageClass="ExportedGlobal")
Spd_Max = Simulink.Parameter(100, StorageClass="ExportedGlobal")
Spd_Inc_Fine = Simulink.Parameter(1, StorageClass="ExportedGlobal")
Spd_Inc_Coarse = Simulink.Parameter(5, StorageClass="ExportedGlobal")