test file "crs_controller_tests"

suite "新規テスト スイート 1"

  case "新規テスト ケース 1" [baseline]

suite "Input_Conditioning"

  case "IC_001_Button_Rise_Detection" [simulation]
    description: コンポーネント 'crs_controller/Input_Conditioning' のテストが生成されました。
    model crs_controller, harness Input_Conditioning_Harness (for crs_controller/Input_Conditioning)
    iterations:
      rise_detection: ModelParameter:, permutationIndex: 1, sysHandle: Input_Conditioning_Harness/Harness Inputs, paramName: ActiveScenario, displayValue: rise_detection, valueString: AAFJTQAAAAAOAAAAQAAAAAYAAAAIAAAABAAAAAAAAAAFAAAACAAAAAEAAAAOAAAAAQAAAAAAAAAQAAAADgAAAHJpc2VfZGV0ZWN0aW9uAAA=

  case "IC_002_Button_Hold_Detection" [simulation]
    description: コンポーネント 'crs_controller/Input_Conditioning' のテストが生成されました。
    model crs_controller, harness Input_Conditioning_Harness (for crs_controller/Input_Conditioning)
    iterations:
      hold_detection: ModelParameter:, permutationIndex: 1, sysHandle: Input_Conditioning_Harness/Harness Inputs, paramName: ActiveScenario, displayValue: hold_detection, valueString: AAFJTQAAAAAOAAAAQAAAAAYAAAAIAAAABAAAAAAAAAAFAAAACAAAAAEAAAAOAAAAAQAAAAAAAAAQAAAADgAAAGhvbGRfZGV0ZWN0aW9uAAA=

  case "IC_003_Brake_Detection" [simulation]
    description: コンポーネント 'crs_controller/Input_Conditioning' のテストが生成されました。
    model crs_controller, harness Input_Conditioning_Harness (for crs_controller/Input_Conditioning)
    iterations:
      brake_active: ModelParameter:, permutationIndex: 1, sysHandle: Input_Conditioning_Harness/Harness Inputs, paramName: ActiveScenario, displayValue: brake_active, valueString: AAFJTQAAAAAOAAAAQAAAAAYAAAAIAAAABAAAAAAAAAAFAAAACAAAAAEAAAAMAAAAAQAAAAAAAAAQAAAADAAAAGJyYWtlX2FjdGl2ZQAAAAA=

  case "IC_004_Key_Decode" [simulation]
    description: コンポーネント 'crs_controller/Input_Conditioning' のテストが生成されました。
    model crs_controller, harness Input_Conditioning_Harness (for crs_controller/Input_Conditioning)
    iterations:
      key_decode: ModelParameter:, permutationIndex: 1, sysHandle: Input_Conditioning_Harness/Harness Inputs, paramName: ActiveScenario, displayValue: key_decode, valueString: AAFJTQAAAAAOAAAAQAAAAAYAAAAIAAAABAAAAAAAAAAFAAAACAAAAAEAAAAKAAAAAQAAAAAAAAAQAAAACgAAAGtleV9kZWNvZGUAAAAAAAA=

  case "IC_005_Gear_Decode" [simulation]
    description: コンポーネント 'crs_controller/Input_Conditioning' のテストが生成されました。
    model crs_controller, harness Input_Conditioning_Harness (for crs_controller/Input_Conditioning)
    iterations:
      gear_decode: ModelParameter:, permutationIndex: 1, sysHandle: Input_Conditioning_Harness/Harness Inputs, paramName: ActiveScenario, displayValue: gear_decode, valueString: AAFJTQAAAAAOAAAAQAAAAAYAAAAIAAAABAAAAAAAAAAFAAAACAAAAAEAAAALAAAAAQAAAAAAAAAQAAAACwAAAGdlYXJfZGVjb2RlAAAAAAA=

  case "IC_006_Speed_Range_Check" [simulation]
    description: コンポーネント 'crs_controller/Input_Conditioning' のテストが生成されました。
    model crs_controller, harness Input_Conditioning_Harness (for crs_controller/Input_Conditioning)
    iterations:
      speed_range: ModelParameter:, permutationIndex: 1, sysHandle: Input_Conditioning_Harness/Harness Inputs, paramName: ActiveScenario, displayValue: speed_range, valueString: AAFJTQAAAAAOAAAAQAAAAAYAAAAIAAAABAAAAAAAAAAFAAAACAAAAAEAAAALAAAAAQAAAAAAAAAQAAAACwAAAHNwZWVkX3JhbmdlAAAAAAA=

suite "Mode_Manager"

  case "MM_001_Mode_Transitions" [simulation]
    description: コンポーネント 'crs_controller/Mode_Manager' のテストが生成されました。
    model crs_controller, harness Mode_Manager_Harness (for crs_controller/Mode_Manager)
    iterations:
      activate: ModelParameter: permutationIndex: 1; sysHandle: Mode_Manager_Harness/Harness Inputs; paramName: ActiveScenario; displayValue: activate; valueString: AAFJTQAAAAAOAAAAOAAAAAYAAAAIAAAABAAAAAAAAAAFAAAACAAAAAEAAAAIAAAAAQAAAAAAAAAQAAAACAAAAGFjdGl2YXRl

  case "MM_002_Accel_Override" [simulation]
    description: コンポーネント 'crs_controller/Mode_Manager' のテストが生成されました。
    model crs_controller, harness Mode_Manager_Harness (for crs_controller/Mode_Manager)
    iterations:
      driver_override: ModelParameter:, permutationIndex: 1, sysHandle: Mode_Manager_Harness/Harness Inputs, paramName: ActiveScenario, displayValue: driver_override, valueString: AAFJTQAAAAAOAAAAQAAAAAYAAAAIAAAABAAAAAAAAAAFAAAACAAAAAEAAAAPAAAAAQAAAAAAAAAQAAAADwAAAGRyaXZlcl9vdmVycmlkZQA=

suite "Target_Speed_Manager"

  case "TSM_001_Set_Target" [simulation]
    description: コンポーネント 'crs_controller/Target_Speed_Manager' のテストが生成されました。
    model crs_controller, harness Target_Speed_Manager_Harness (for crs_controller/Target_Speed_Manager)
    iterations:
      set_target: ModelParameter:, permutationIndex: 1, sysHandle: Target_Speed_Manager_Harness/Harness Inputs, paramName: ActiveScenario, displayValue: set_target, valueString: AAFJTQAAAAAOAAAAQAAAAAYAAAAIAAAABAAAAAAAAAAFAAAACAAAAAEAAAAKAAAAAQAAAAAAAAAQAAAACgAAAHNldF90YXJnZXQAAAAAAAA=

  case "TSM_002_Resume_Target" [simulation]
    description: コンポーネント 'crs_controller/Target_Speed_Manager' のテストが生成されました。
    model crs_controller, harness Target_Speed_Manager_Harness (for crs_controller/Target_Speed_Manager)
    iterations:
      resume_prev: ModelParameter:, permutationIndex: 1, sysHandle: Target_Speed_Manager_Harness/Harness Inputs, paramName: ActiveScenario, displayValue: resume_prev, valueString: AAFJTQAAAAAOAAAAQAAAAAYAAAAIAAAABAAAAAAAAAAFAAAACAAAAAEAAAALAAAAAQAAAAAAAAAQAAAACwAAAHJlc3VtZV9wcmV2AAAAAAA=

  case "TSM_003_Increment" [simulation]
    description: コンポーネント 'crs_controller/Target_Speed_Manager' のテストが生成されました。
    model crs_controller, harness Target_Speed_Manager_Harness (for crs_controller/Target_Speed_Manager)
    iterations:
      increment: ModelParameter:, permutationIndex: 1, sysHandle: Target_Speed_Manager_Harness/Harness Inputs, paramName: ActiveScenario, displayValue: increment, valueString: AAFJTQAAAAAOAAAAQAAAAAYAAAAIAAAABAAAAAAAAAAFAAAACAAAAAEAAAAJAAAAAQAAAAAAAAAQAAAACQAAAGluY3JlbWVudAAAAAAAAAA=

  case "TSM_004_Decrement" [simulation]
    description: コンポーネント 'crs_controller/Target_Speed_Manager' のテストが生成されました。
    model crs_controller, harness Target_Speed_Manager_Harness (for crs_controller/Target_Speed_Manager)
    iterations:
      decrement: ModelParameter:, permutationIndex: 1, sysHandle: Target_Speed_Manager_Harness/Harness Inputs, paramName: ActiveScenario, displayValue: decrement, valueString: AAFJTQAAAAAOAAAAQAAAAAYAAAAIAAAABAAAAAAAAAAFAAAACAAAAAEAAAAJAAAAAQAAAAAAAAAQAAAACQAAAGRlY3JlbWVudAAAAAAAAAA=

  case "TSM_005_Accel_Release" [simulation]
    description: コンポーネント 'crs_controller/Target_Speed_Manager' のテストが生成されました。
    model crs_controller, harness Target_Speed_Manager_Harness (for crs_controller/Target_Speed_Manager)
    iterations:
      accel_release: ModelParameter:, permutationIndex: 1, sysHandle: Target_Speed_Manager_Harness/Harness Inputs, paramName: ActiveScenario, displayValue: accel_release, valueString: AAFJTQAAAAAOAAAAQAAAAAYAAAAIAAAABAAAAAAAAAAFAAAACAAAAAEAAAANAAAAAQAAAAAAAAAQAAAADQAAAGFjY2VsX3JlbGVhc2UAAAA=

  case "TSM_006_Speed_Clamp" [simulation]
    description: コンポーネント 'crs_controller/Target_Speed_Manager' のテストが生成されました。
    model crs_controller, harness Target_Speed_Manager_Harness (for crs_controller/Target_Speed_Manager)
    iterations:
      speed_clamp: ModelParameter:, permutationIndex: 1, sysHandle: Target_Speed_Manager_Harness/Harness Inputs, paramName: ActiveScenario, displayValue: speed_clamp, valueString: AAFJTQAAAAAOAAAAQAAAAAYAAAAIAAAABAAAAAAAAAAFAAAACAAAAAEAAAALAAAAAQAAAAAAAAAQAAAACwAAAHNwZWVkX2NsYW1wAAAAAAA=

suite "PID_Throttle_Controller"

  case "PID_001_Speed_Error" [simulation]
    description: コンポーネント 'crs_controller/PID_Throttle_Controller' のテストが生成されました。
    model crs_controller, harness PID_Throttle_Controller_Harness (for crs_controller/PID_Throttle_Controller)
    iterations:
      tracking_error: ModelParameter:, permutationIndex: 1, sysHandle: PID_Throttle_Controller_Harness/Harness Inputs, paramName: ActiveScenario, displayValue: tracking_error, valueString: AAFJTQAAAAAOAAAAQAAAAAYAAAAIAAAABAAAAAAAAAAFAAAACAAAAAEAAAAOAAAAAQAAAAAAAAAQAAAADgAAAHRyYWNraW5nX2Vycm9yAAA=

  case "PID_002_PID_Core" [simulation]
    description: コンポーネント 'crs_controller/PID_Throttle_Controller' のテストが生成されました。
    model crs_controller, harness PID_Throttle_Controller_Harness (for crs_controller/PID_Throttle_Controller)
    iterations:
      bumpless_transfer: ModelParameter: permutationIndex: 1; sysHandle: PID_Throttle_Controller_Harness/Harness Inputs; paramName: ActiveScenario; displayValue: bumpless_transfer

  case "PID_003_Output_Gate" [simulation]
    description: コンポーネント 'crs_controller/PID_Throttle_Controller' のテストが生成されました。
    model crs_controller, harness PID_Throttle_Controller_Harness (for crs_controller/PID_Throttle_Controller)
    iterations:
      pid_disabled: ModelParameter:, permutationIndex: 1, sysHandle: PID_Throttle_Controller_Harness/Harness Inputs, paramName: ActiveScenario, displayValue: pid_disabled, valueString: AAFJTQAAAAAOAAAAQAAAAAYAAAAIAAAABAAAAAAAAAAFAAAACAAAAAEAAAAMAAAAAQAAAAAAAAAQAAAADAAAAHBpZF9kaXNhYmxlZAAAAAA=

suite "Output_Logic"

  case "OL_001_Activation_Check" [simulation]
    description: コンポーネント 'crs_controller/Output_Logic' のテストが生成されました。
    model crs_controller, harness Output_Logic_Harness (for crs_controller/Output_Logic)
    iterations:
      activated_no_override: ModelParameter: permutationIndex: 1; sysHandle: Output_Logic_Harness/Harness Inputs; paramName: ActiveScenario; displayValue: activated_no_override

  case "OL_002_Throttle_Output" [simulation]
    description: コンポーネント 'crs_controller/Output_Logic' のテストが生成されました。
    model crs_controller, harness Output_Logic_Harness (for crs_controller/Output_Logic)
    iterations:
      saturation: ModelParameter:, permutationIndex: 1, sysHandle: Output_Logic_Harness/Harness Inputs, paramName: ActiveScenario, displayValue: saturation, valueString: AAFJTQAAAAAOAAAAQAAAAAYAAAAIAAAABAAAAAAAAAAFAAAACAAAAAEAAAAKAAAAAQAAAAAAAAAQAAAACgAAAHNhdHVyYXRpb24AAAAAAAA=